# Grasshopper definition DesignCreator.gh (Grasshopper 1.0.7)
# plug-ins: NGon, MetaHopper, EF - R7 Beta, LunchBox, Karamba3D

column_to_column_distance = ValueList({"3.6 meters": 3.6, "5.4 meters": 5.4, "7.2 meters": 7.2, "10.8 meters": 10.8}, selected="3.6 meters")
amount_of_column_spans = Slider(3, range=0..10)
# Structural height of floor:
type_of_floor = ValueList({"Heavy floor (VBI slab)": 3, "Light floor (CLT slab)": 1}, selected="Heavy floor (VBI slab)")
floor_span_in_meters = ValueList({"3.6 meters": 3.6, "5.4 meters": 5.4, "7.2 meters": 7.2, "10.8 meters": 10.8}, selected="10.8 meters")
amount_of_floor_spans = Slider(3, range=0..10)
amount_of_storeys = Slider(3, range=1..3)
floorheight = Slider(3.5, range=0..10)
save_design = Button()

docinfo = DocumentInfo(AutoUpdate=False, Recursive=False)  # -> DocumentName, DocumentFilePath, Components, Params, _3rdPartyAssemblies
decpath = DeconstructFilePath(FilePath=docinfo.DocumentFilePath)  # -> Folder, FileName, FileNameWithExtension
# Visualization
panel = Panel("{0}{1}")
# INPUT
panel_2 = Panel("b*bc*d*dc*f")
format = Format(Format=panel, Culture=127, Data0=decpath.Folder, Data1="\Case1.xlsx")
get_floorheight = GetFloorheight(P=[type_of_floor, floor_span_in_meters])
panel_3 = Panel(get_floorheight)
eval = Evaluate(
    F=panel_2,
    b=column_to_column_distance,
    d=floor_span_in_meters,
    f=amount_of_storeys,
    bc=amount_of_column_spans,
    dc=amount_of_floor_spans)
multiplication = Multiplication(A=amount_of_storeys, B=floorheight)
pt = ConstructPoint(XCoordinate=0, YCoordinate=10, ZCoordinate=0)
format_2 = Format(Format="{0} m2", Culture=127, Data0=eval)
multiplication_2 = Multiplication(A=amount_of_column_spans, B=column_to_column_distance)
multiplication_3 = Multiplication(A=amount_of_floor_spans, B=floor_span_in_meters)
# Create geometry and labels
text = Text(Location=pt, Text=format_2, Size="6", Bold=False, HorizontalAlignment=0, VerticalAlignment=0)

series = Series(Start=0, Step=column_to_column_distance, Count=expr("x+1", amount_of_column_spans))
pt_2 = ConstructPoint(XCoordinate=series, YCoordinate=20, ZCoordinate=0)
series_2 = Series(Start=0, Step=floorheight, Count=expr("x+1", amount_of_storeys))  # -> graft(Series)
Z = UnitZ(Factor=series_2)
move = Move(Geometry=pt_2, Motion=Z)  # -> Geometry, Transform
shift = ShiftList(List=flatten(move.Geometry), Shift=expr("x+1", amount_of_column_spans), Wrap=True)
shift_2 = ShiftList(List=flatten(move.Geometry), Shift=1, Wrap=True)
ln = Line(StartPoint=flatten(move.Geometry), EndPoint=shift)
ln_2 = Line(StartPoint=flatten(move.Geometry), EndPoint=shift_2)
series_3 = Series(Start=0, Step=floor_span_in_meters, Count=expr("x+1", amount_of_floor_spans))
len = Length(Curve=ln)
culln = CullNth(List=ln_2, CullFrequency=expr("x+1", amount_of_column_spans))
lng = ListLength(List=len)
Y = UnitY(Factor=series_3)
split = SplitList(List=culln, Index=amount_of_column_spans)  # -> ListA, ListB
line = Line(split.ListB)
subtraction = Subtraction(A=lng, B=amount_of_column_spans)
split_2 = SplitList(List=ln, Index=expr("x-1", subtraction))  # -> ListA, ListB
line_2 = Line(split_2.ListA)
move_2 = Move(Geometry=flatten(line), Motion=graft(Y))  # -> Geometry, Transform
move_3 = Move(Geometry=flatten(line_2), Motion=graft(Y))  # -> Geometry, Transform
end = EndPoints(Curve=move_2.Geometry)  # -> Start, End
pdecon = Deconstruct(Point=end.Start)  # -> XComponent, YComponent, ZComponent
end_2 = EndPoints(Curve=move_3.Geometry)  # -> Start, End
division = Division(A=column_to_column_distance, B=2)
division_2 = Division(A=pdecon.XComponent, B=column_to_column_distance)
division_3 = Division(A=pdecon.ZComponent, B=floorheight)
pdecon_2 = Deconstruct(Point=end_2.Start)  # -> XComponent, YComponent, ZComponent
addition = Addition(A=pdecon.XComponent, B=division)
division_4 = Division(A=floorheight, B=2)
charseq = CharSequence(Count=expr("x+1", division_2), CharPool="ABCDEFGHIJKLMNOPQRSTUVWXYZ", Format="{0}")
division_5 = Division(A=pdecon_2.XComponent, B=column_to_column_distance)
division_6 = Division(A=pdecon_2.ZComponent, B=floorheight)
pt_3 = ConstructPoint(XCoordinate=addition, YCoordinate=pdecon.YComponent, ZCoordinate=pdecon.ZComponent)
addition_2 = Addition(A=pdecon_2.ZComponent, B=division_4)
lng_2 = ListLength(List=charseq)
addition_3 = Addition(A=division_6, B=1)
charseq_2 = CharSequence(Count=expr("x+1", division_5), CharPool="ABCDEFGHIJKLMNOPQRSTUVWXYZ", Format="{0}")
item = ListItem(List=charseq, Index=expr("x-1", lng_2), Wrap=True)
pt_4 = ConstructPoint(XCoordinate=pdecon_2.XComponent, YCoordinate=pdecon_2.YComponent, ZCoordinate=addition_2)
lng_3 = ListLength(List=charseq_2)
path_mapper = PathMapper(item, source="{A;B;C;D}", target="{C}")
item_2 = ListItem(List=charseq_2, Index=expr("x-1", lng_3), Wrap=True)
series_4 = Series(Start=1, Step=1, Count=expr("x+1", amount_of_floor_spans))  # -> graft(Series)
path_mapper_2 = PathMapper(item_2, source="{A;B;C;D}", target="{C}")
series_5 = Series(Start=1, Step=1, Count=expr("x+1", amount_of_floor_spans))  # -> graft(Series)
format_3 = Format(Format="{2}B{0}{1}", Culture=127, Data0=division_3, Data1=path_mapper, Data2=series_4)
text_2 = Text(Location=pt_3, Text=format_3, Size="1", Bold=False, HorizontalAlignment=0, VerticalAlignment=0)
len_2 = Length(Curve=move_2.Geometry)  # -> flatten(Length)
format_4 = Format(Format="{2}C{0}{1}", Culture=127, Data0=addition_3, Data1=path_mapper_2, Data2=series_5)
len_3 = Length(Curve=move_3.Geometry)  # -> flatten(Length)
text_3 = Text(Location=pt_4, Text=format_4, Size="1", Bold=False, HorizontalAlignment=0, VerticalAlignment=0)

docinfo_2 = DocumentInfo(AutoUpdate=False, Recursive=False)  # -> DocumentName, DocumentFilePath, Components, Params, _3rdPartyAssemblies
decpath_2 = DeconstructFilePath(FilePath=docinfo_2.DocumentFilePath)  # -> Folder, FileName, FileNameWithExtension
entwine = Entwine(Branch00=flatten(format_3), Branch01=flatten(len_2), FlattenInputs=True)
entwine_2 = Entwine(Branch00=flatten(format_4), Branch01=flatten(len_3), FlattenInputs=True)
format_5 = Format(Format="{0}{1}", Culture=127, Data0=decpath_2.Folder, Data1="\GHuitvoer.xlsx")
panel_4 = Panel("""ID
Length""")
panel_5 = Panel("""ID
Length""")
excelwrite = ExcelWrite(
    WriteExcelData=save_design,
    WorkbookPath=format_5,
    WorksheetName="geometrybeams",
    ColumnHeadings=flatten(panel_4),
    Data=entwine,
    ClearSheet=True)
excelwrite_2 = ExcelWrite(
    WriteExcelData=save_design,
    WorkbookPath=format_5,
    WorksheetName="geometrycolumns",
    ColumnHeadings=flatten(panel_5),
    Data=entwine_2,
    ClearSheet=True)
entwine_3 = Entwine(
    Branch00=column_to_column_distance,
    Branch01=amount_of_column_spans,
    Branch02=amount_of_storeys,
    Branch03=floorheight,
    Branch04=amount_of_floor_spans,
    Branch05=floor_span_in_meters,
    Branch06=type_of_floor,
    FlattenInputs=True)
panel_6 = Panel("""hohkolom
#kolomspans
#verdiepingen
verdiepingshoogte
#floorspans
floorspan
Gfloor""")
excelwrite_3 = ExcelWrite(
    WriteExcelData=save_design,
    WorkbookPath=format_5,
    WorksheetName="inputarg",
    ColumnHeadings=flatten(panel_6),
    Data=entwine_3,
    ClearSheet=True)

series_6 = Series(Start=expr("x+20", multiplication_2), Step=column_to_column_distance, Count=expr("x+1", amount_of_column_spans))
pt_5 = ConstructPoint(XCoordinate=series_6, YCoordinate=expr("2*-x-40", multiplication_3), ZCoordinate=0)
series_7 = Series(Start=0, Step=floorheight, Count=expr("x+1", amount_of_storeys))  # -> graft(Series)
Z_2 = UnitZ(Factor=series_7)
move_4 = Move(Geometry=pt_5, Motion=Z_2)  # -> Geometry, Transform
shift_3 = ShiftList(List=flatten(move_4.Geometry), Shift=expr("x+1", amount_of_column_spans), Wrap=True)
shift_4 = ShiftList(List=flatten(move_4.Geometry), Shift=1, Wrap=True)
ln_3 = Line(StartPoint=flatten(move_4.Geometry), EndPoint=shift_3)
ln_4 = Line(StartPoint=flatten(move_4.Geometry), EndPoint=shift_4)
series_8 = Series(Start=0, Step=floor_span_in_meters, Count=expr("x+1", amount_of_floor_spans))
len_4 = Length(Curve=ln_3)
culln_2 = CullNth(List=ln_4, CullFrequency=expr("x+1", amount_of_column_spans))
lng_4 = ListLength(List=len_4)
Y_2 = UnitY(Factor=series_8)
split_3 = SplitList(List=culln_2, Index=amount_of_column_spans)  # -> ListA, ListB
line_3 = Line(split_3.ListB)
subtraction_2 = Subtraction(A=lng_4, B=amount_of_column_spans)
split_4 = SplitList(List=ln_3, Index=expr("x-1", subtraction_2))  # -> ListA, ListB
line_4 = Line(split_4.ListA)
move_5 = Move(Geometry=flatten(line_3), Motion=graft(Y_2))  # -> Geometry, Transform
move_6 = Move(Geometry=flatten(line_4), Motion=graft(Y_2))  # -> Geometry, Transform
end_3 = EndPoints(Curve=move_5.Geometry)  # -> Start, End
pdecon_3 = Deconstruct(Point=end_3.Start)  # -> XComponent, YComponent, ZComponent
end_4 = EndPoints(Curve=move_6.Geometry)  # -> Start, End
division_7 = Division(A=column_to_column_distance, B=2)
division_8 = Division(A=pdecon_3.ZComponent, B=floorheight)
division_9 = Division(A=pdecon_3.XComponent, B=column_to_column_distance)
pdecon_4 = Deconstruct(Point=end_4.Start)  # -> XComponent, YComponent, ZComponent
addition_4 = Addition(A=pdecon_3.XComponent, B=division_7)
division_10 = Division(A=floorheight, B=2)
division_11 = Division(A=pdecon_4.XComponent, B=column_to_column_distance)
division_12 = Division(A=pdecon_4.ZComponent, B=floorheight)
pt_6 = ConstructPoint(XCoordinate=addition_4, YCoordinate=pdecon_3.YComponent, ZCoordinate=pdecon_3.ZComponent)
lng_5 = ListLength(List=charseq)
addition_5 = Addition(A=pdecon_4.ZComponent, B=division_10)
addition_6 = Addition(A=division_12, B=1)
charseq_3 = CharSequence(Count=expr("x+1", division_11), CharPool="ABCDEFGHIJKLMNOPQRSTUVWXYZ", Format="{0}")
item_3 = ListItem(List=charseq, Index=expr("x-1", lng_5), Wrap=True)
pt_7 = ConstructPoint(XCoordinate=pdecon_4.XComponent, YCoordinate=pdecon_4.YComponent, ZCoordinate=addition_5)
lng_6 = ListLength(List=charseq_2)
path_mapper_3 = PathMapper(item_3, source="{A;B;C;D}", target="{C}")
item_4 = ListItem(List=charseq_2, Index=expr("x-1", lng_6), Wrap=True)
series_9 = Series(Start=1, Step=1, Count=expr("x+1", amount_of_floor_spans))  # -> graft(Series)
path_mapper_4 = PathMapper(item_4, source="{A;B;C;D}", target="{C}")
series_10 = Series(Start=1, Step=1, Count=expr("x+1", amount_of_floor_spans))  # -> graft(Series)
format_6 = Format(Format="{2}B{0}{1}", Culture=127, Data0=division_8, Data1=path_mapper_3, Data2=series_9)
text_4 = Text(Location=pt_6, Text=format_6, Size="1", Bold=False, HorizontalAlignment=0, VerticalAlignment=0)
len_5 = Length(Curve=move_5.Geometry)  # -> flatten(Length)
format_7 = Format(Format="{2}C{0}{1}", Culture=127, Data0=addition_6, Data1=path_mapper_4, Data2=series_10)
len_6 = Length(Curve=move_6.Geometry)  # -> flatten(Length)
text_5 = Text(Location=pt_7, Text=format_7, Size="1", Bold=False, HorizontalAlignment=0, VerticalAlignment=0)

series_11 = Series(Start=expr("x+20", multiplication_2), Step=column_to_column_distance, Count=expr("x+1", amount_of_column_spans))
pt_8 = ConstructPoint(XCoordinate=series_11, YCoordinate=expr("-x-20", multiplication_3), ZCoordinate=0)
series_12 = Series(Start=0, Step=floorheight, Count=expr("x+1", amount_of_storeys))  # -> graft(Series)
Z_3 = UnitZ(Factor=series_12)
move_7 = Move(Geometry=pt_8, Motion=Z_3)  # -> Geometry, Transform
shift_5 = ShiftList(List=flatten(move_7.Geometry), Shift=expr("x+1", amount_of_column_spans), Wrap=True)
shift_6 = ShiftList(List=flatten(move_7.Geometry), Shift=1, Wrap=True)
ln_5 = Line(StartPoint=flatten(move_7.Geometry), EndPoint=shift_5)
ln_6 = Line(StartPoint=flatten(move_7.Geometry), EndPoint=shift_6)
series_13 = Series(Start=0, Step=floor_span_in_meters, Count=expr("x+1", amount_of_floor_spans))
len_7 = Length(Curve=ln_5)
culln_3 = CullNth(List=ln_6, CullFrequency=expr("x+1", amount_of_column_spans))
lng_7 = ListLength(List=len_7)
Y_3 = UnitY(Factor=series_13)
split_5 = SplitList(List=culln_3, Index=amount_of_column_spans)  # -> ListA, ListB
line_5 = Line(split_5.ListB)
subtraction_3 = Subtraction(A=lng_7, B=amount_of_column_spans)
split_6 = SplitList(List=ln_5, Index=expr("x-1", subtraction_3))  # -> ListA, ListB
line_6 = Line(split_6.ListA)
move_8 = Move(Geometry=flatten(line_5), Motion=graft(Y_3))  # -> Geometry, Transform
move_9 = Move(Geometry=flatten(line_6), Motion=graft(Y_3))  # -> Geometry, Transform
end_5 = EndPoints(Curve=move_8.Geometry)  # -> Start, End
pdecon_5 = Deconstruct(Point=end_5.Start)  # -> XComponent, YComponent, ZComponent
end_6 = EndPoints(Curve=move_9.Geometry)  # -> Start, End
division_13 = Division(A=column_to_column_distance, B=2)
division_14 = Division(A=pdecon_5.ZComponent, B=floorheight)
division_15 = Division(A=pdecon_5.XComponent, B=column_to_column_distance)
pdecon_6 = Deconstruct(Point=end_6.Start)  # -> XComponent, YComponent, ZComponent
addition_7 = Addition(A=pdecon_5.XComponent, B=division_13)
division_16 = Division(A=floorheight, B=2)
division_17 = Division(A=pdecon_6.XComponent, B=column_to_column_distance)
division_18 = Division(A=pdecon_6.ZComponent, B=floorheight)
pt_9 = ConstructPoint(XCoordinate=addition_7, YCoordinate=pdecon_5.YComponent, ZCoordinate=pdecon_5.ZComponent)
lng_8 = ListLength(List=charseq)
addition_8 = Addition(A=pdecon_6.ZComponent, B=division_16)
addition_9 = Addition(A=division_18, B=1)
charseq_4 = CharSequence(Count=expr("x+1", division_17), CharPool="ABCDEFGHIJKLMNOPQRSTUVWXYZ", Format="{0}")
item_5 = ListItem(List=charseq, Index=expr("x-1", lng_8), Wrap=True)
pt_10 = ConstructPoint(XCoordinate=pdecon_6.XComponent, YCoordinate=pdecon_6.YComponent, ZCoordinate=addition_8)
lng_9 = ListLength(List=charseq_2)
path_mapper_5 = PathMapper(item_5, source="{A;B;C;D}", target="{C}")
item_6 = ListItem(List=charseq_2, Index=expr("x-1", lng_9), Wrap=True)
series_14 = Series(Start=1, Step=1, Count=expr("x+1", amount_of_floor_spans))  # -> graft(Series)
path_mapper_6 = PathMapper(item_6, source="{A;B;C;D}", target="{C}")
series_15 = Series(Start=1, Step=1, Count=expr("x+1", amount_of_floor_spans))  # -> graft(Series)
format_8 = Format(Format="{2}B{0}{1}", Culture=127, Data0=division_14, Data1=path_mapper_5, Data2=series_14)
text_6 = Text(Location=pt_9, Text=format_8, Size="1", Bold=False, HorizontalAlignment=0, VerticalAlignment=0)
len_8 = Length(Curve=move_8.Geometry)  # -> flatten(Length)
format_9 = Format(Format="{2}C{0}{1}", Culture=127, Data0=addition_9, Data1=path_mapper_6, Data2=series_15)
len_9 = Length(Curve=move_9.Geometry)  # -> flatten(Length)
text_7 = Text(Location=pt_10, Text=format_9, Size="1", Bold=False, HorizontalAlignment=0, VerticalAlignment=0)

series_16 = Series(Start=0, Step=column_to_column_distance, Count=expr("x+1", amount_of_column_spans))
pt_11 = ConstructPoint(XCoordinate=series_16, YCoordinate=expr("-2*x-40", multiplication_3), ZCoordinate=0)
series_17 = Series(Start=0, Step=floorheight, Count=expr("x+1", amount_of_storeys))  # -> graft(Series)
Z_4 = UnitZ(Factor=series_17)
move_10 = Move(Geometry=pt_11, Motion=Z_4)  # -> Geometry, Transform
shift_7 = ShiftList(List=flatten(move_10.Geometry), Shift=expr("x+1", amount_of_column_spans), Wrap=True)
shift_8 = ShiftList(List=flatten(move_10.Geometry), Shift=1, Wrap=True)
ln_7 = Line(StartPoint=flatten(move_10.Geometry), EndPoint=shift_7)
ln_8 = Line(StartPoint=flatten(move_10.Geometry), EndPoint=shift_8)
series_18 = Series(Start=0, Step=floor_span_in_meters, Count=expr("x+1", amount_of_floor_spans))
len_10 = Length(Curve=ln_7)
culln_4 = CullNth(List=ln_8, CullFrequency=expr("x+1", amount_of_column_spans))
lng_10 = ListLength(List=len_10)
Y_4 = UnitY(Factor=series_18)
split_7 = SplitList(List=culln_4, Index=amount_of_column_spans)  # -> ListA, ListB
line_7 = Line(split_7.ListB)
subtraction_4 = Subtraction(A=lng_10, B=amount_of_column_spans)
split_8 = SplitList(List=ln_7, Index=expr("x-1", subtraction_4))  # -> ListA, ListB
line_8 = Line(split_8.ListA)
move_11 = Move(Geometry=flatten(line_7), Motion=graft(Y_4))  # -> Geometry, Transform
move_12 = Move(Geometry=flatten(line_8), Motion=graft(Y_4))  # -> Geometry, Transform
end_7 = EndPoints(Curve=move_11.Geometry)  # -> Start, End
pdecon_7 = Deconstruct(Point=end_7.Start)  # -> XComponent, YComponent, ZComponent
end_8 = EndPoints(Curve=move_12.Geometry)  # -> Start, End
division_19 = Division(A=column_to_column_distance, B=2)
division_20 = Division(A=pdecon_7.ZComponent, B=floorheight)
division_21 = Division(A=pdecon_7.XComponent, B=column_to_column_distance)
pdecon_8 = Deconstruct(Point=end_8.Start)  # -> XComponent, YComponent, ZComponent
addition_10 = Addition(A=pdecon_7.XComponent, B=division_19)
division_22 = Division(A=floorheight, B=2)
division_23 = Division(A=pdecon_8.XComponent, B=column_to_column_distance)
division_24 = Division(A=pdecon_8.ZComponent, B=floorheight)
pt_12 = ConstructPoint(XCoordinate=addition_10, YCoordinate=pdecon_7.YComponent, ZCoordinate=pdecon_7.ZComponent)
lng_11 = ListLength(List=charseq)
addition_11 = Addition(A=pdecon_8.ZComponent, B=division_22)
addition_12 = Addition(A=division_24, B=1)
charseq_5 = CharSequence(Count=expr("x+1", division_23), CharPool="ABCDEFGHIJKLMNOPQRSTUVWXYZ", Format="{0}")
item_7 = ListItem(List=charseq, Index=expr("x-1", lng_11), Wrap=True)
pt_13 = ConstructPoint(XCoordinate=pdecon_8.XComponent, YCoordinate=pdecon_8.YComponent, ZCoordinate=addition_11)
lng_12 = ListLength(List=charseq_2)
path_mapper_7 = PathMapper(item_7, source="{A;B;C;D}", target="{C}")
item_8 = ListItem(List=charseq_2, Index=expr("x-1", lng_12), Wrap=True)
series_19 = Series(Start=1, Step=1, Count=expr("x+1", amount_of_floor_spans))  # -> graft(Series)
path_mapper_8 = PathMapper(item_8, source="{A;B;C;D}", target="{C}")
series_20 = Series(Start=1, Step=1, Count=expr("x+1", amount_of_floor_spans))  # -> graft(Series)
format_10 = Format(Format="{2}B{0}{1}", Culture=127, Data0=division_20, Data1=path_mapper_7, Data2=series_19)
text_8 = Text(Location=pt_12, Text=format_10, Size="1", Bold=False, HorizontalAlignment=0, VerticalAlignment=0)
len_11 = Length(Curve=move_11.Geometry)  # -> flatten(Length)
format_11 = Format(Format="{2}C{0}{1}", Culture=127, Data0=addition_12, Data1=path_mapper_8, Data2=series_20)
len_12 = Length(Curve=move_12.Geometry)  # -> flatten(Length)
text_9 = Text(Location=pt_13, Text=format_11, Size="1", Bold=False, HorizontalAlignment=0, VerticalAlignment=0)

series_21 = Series(Start=0, Step=column_to_column_distance, Count=expr("x+1", amount_of_column_spans))
pt_14 = ConstructPoint(XCoordinate=series_21, YCoordinate=expr("-x-20", multiplication_3), ZCoordinate=0)
series_22 = Series(Start=0, Step=floorheight, Count=expr("x+1", amount_of_storeys))  # -> graft(Series)
Z_5 = UnitZ(Factor=series_22)
move_13 = Move(Geometry=pt_14, Motion=Z_5)  # -> Geometry, Transform
shift_9 = ShiftList(List=flatten(move_13.Geometry), Shift=expr("x+1", amount_of_column_spans), Wrap=True)
shift_10 = ShiftList(List=flatten(move_13.Geometry), Shift=1, Wrap=True)
ln_9 = Line(StartPoint=flatten(move_13.Geometry), EndPoint=shift_9)
ln_10 = Line(StartPoint=flatten(move_13.Geometry), EndPoint=shift_10)
series_23 = Series(Start=0, Step=floor_span_in_meters, Count=expr("x+1", amount_of_floor_spans))
len_13 = Length(Curve=ln_9)
culln_5 = CullNth(List=ln_10, CullFrequency=expr("x+1", amount_of_column_spans))
lng_13 = ListLength(List=len_13)
Y_5 = UnitY(Factor=series_23)
split_9 = SplitList(List=culln_5, Index=amount_of_column_spans)  # -> ListA, ListB
line_9 = Line(split_9.ListB)
subtraction_5 = Subtraction(A=lng_13, B=amount_of_column_spans)
split_10 = SplitList(List=ln_9, Index=expr("x-1", subtraction_5))  # -> ListA, ListB
line_10 = Line(split_10.ListA)
move_14 = Move(Geometry=flatten(line_9), Motion=graft(Y_5))  # -> Geometry, Transform
move_15 = Move(Geometry=flatten(line_10), Motion=graft(Y_5))  # -> Geometry, Transform
end_9 = EndPoints(Curve=move_14.Geometry)  # -> Start, End
pdecon_9 = Deconstruct(Point=end_9.Start)  # -> XComponent, YComponent, ZComponent
end_10 = EndPoints(Curve=move_15.Geometry)  # -> Start, End
division_25 = Division(A=column_to_column_distance, B=2)
division_26 = Division(A=pdecon_9.ZComponent, B=floorheight)
division_27 = Division(A=pdecon_9.XComponent, B=column_to_column_distance)
pdecon_10 = Deconstruct(Point=end_10.Start)  # -> XComponent, YComponent, ZComponent
addition_13 = Addition(A=pdecon_9.XComponent, B=division_25)
division_28 = Division(A=floorheight, B=2)
division_29 = Division(A=pdecon_10.XComponent, B=column_to_column_distance)
division_30 = Division(A=pdecon_10.ZComponent, B=floorheight)
pt_15 = ConstructPoint(XCoordinate=addition_13, YCoordinate=pdecon_9.YComponent, ZCoordinate=pdecon_9.ZComponent)
lng_14 = ListLength(List=charseq)
addition_14 = Addition(A=pdecon_10.ZComponent, B=division_28)
addition_15 = Addition(A=division_30, B=1)
charseq_6 = CharSequence(Count=expr("x+1", division_29), CharPool="ABCDEFGHIJKLMNOPQRSTUVWXYZ", Format="{0}")
item_9 = ListItem(List=charseq, Index=expr("x-1", lng_14), Wrap=True)
pt_16 = ConstructPoint(XCoordinate=pdecon_10.XComponent, YCoordinate=pdecon_10.YComponent, ZCoordinate=addition_14)
lng_15 = ListLength(List=charseq_2)
path_mapper_9 = PathMapper(item_9, source="{A;B;C;D}", target="{C}")
item_10 = ListItem(List=charseq_2, Index=expr("x-1", lng_15), Wrap=True)
series_24 = Series(Start=1, Step=1, Count=expr("x+1", amount_of_floor_spans))  # -> graft(Series)
path_mapper_10 = PathMapper(item_10, source="{A;B;C;D}", target="{C}")
series_25 = Series(Start=1, Step=1, Count=expr("x+1", amount_of_floor_spans))  # -> graft(Series)
format_12 = Format(Format="{2}B{0}{1}", Culture=127, Data0=division_26, Data1=path_mapper_9, Data2=series_24)
text_10 = Text(Location=pt_15, Text=format_12, Size="1", Bold=False, HorizontalAlignment=0, VerticalAlignment=0)
len_14 = Length(Curve=move_14.Geometry)  # -> flatten(Length)
format_13 = Format(Format="{2}C{0}{1}", Culture=127, Data0=addition_15, Data1=path_mapper_10, Data2=series_25)
len_15 = Length(Curve=move_15.Geometry)  # -> flatten(Length)
text_11 = Text(Location=pt_16, Text=format_13, Size="1", Bold=False, HorizontalAlignment=0, VerticalAlignment=0)

multiplication_4 = Multiplication(A=column_to_column_distance, B=amount_of_column_spans)
series_26 = Series(Start=0, Step=floor_span_in_meters, Count=expr("x+1", amount_of_floor_spans))  # -> graft(Series)
excelread = ExcelReader(ReadExcelData=Toggle(True), WorkbookPath=format, WorksheetName="ColumnModel1")  # -> Exceptions, ExcelData
excelread_2 = ExcelReader(ReadExcelData=Toggle(True), WorkbookPath=format, WorksheetName="ColumnLengthModel1")  # -> Exceptions, ExcelData
excelread_3 = ExcelReader(ReadExcelData=Toggle(True), WorkbookPath=format, WorksheetName="BeamModel2")  # -> Exceptions, ExcelData
excelread_4 = ExcelReader(ReadExcelData=Toggle(True), WorkbookPath=format, WorksheetName="BeamLengthModel2")  # -> Exceptions, ExcelData
series_27 = Series(Start=floorheight, Step=floorheight, Count=amount_of_storeys)
excelread_5 = ExcelReader(ReadExcelData=Toggle(True), WorkbookPath=format, WorksheetName="GHbeams")  # -> Exceptions, ExcelData
pt_17 = ConstructPoint(XCoordinate=multiplication_4, YCoordinate=series_26, ZCoordinate=series_27)
pt_18 = ConstructPoint(XCoordinate=0, YCoordinate=series_26, ZCoordinate=series_27)
excelread_6 = ExcelReader(ReadExcelData=Toggle(True), WorkbookPath=format, WorksheetName="GHcolumns")  # -> Exceptions, ExcelData
addition_16 = Addition(A=amount_of_floor_spans, B=1)
ln_11 = Line(StartPoint=pt_18, EndPoint=pt_17)
addition_17 = Addition(A=amount_of_column_spans, B=1)
pt_19 = ConstructPoint(XCoordinate=0, YCoordinate=0, ZCoordinate=0)
pt_20 = ConstructPoint(XCoordinate=expr("x+20", multiplication_2), YCoordinate=expr("-2*x-40", multiplication_3), ZCoordinate=0)
addition_18 = Addition(A=amount_of_floor_spans, B=1)
multiplication_5 = Multiplication(A=addition_17, B=addition_16)
multiplication_6 = Multiplication(A=amount_of_storeys, B=addition_18)
vec2pt = Vector2Pt(PointA=pt_19, PointB=pt_20, Unitize=False)  # -> Vector, Length
series_28 = Series(Start=0, Step=floor_span_in_meters, Count=expr("x+1", amount_of_floor_spans))  # -> graft(Series)
series_29 = Series(Start=0, Step=column_to_column_distance, Count=expr("x+1", amount_of_column_spans))
series_30 = Series(Start=0, Step=0, Count=multiplication_5)
split_11 = SplitList(List=excelread_2.ExcelData, Index=1)  # -> ListA, ListB
split_12 = SplitList(List=excelread.ExcelData, Index=1)  # -> ListA, ListB
split_13 = SplitList(List=excelread_4.ExcelData, Index=1)  # -> ListA, ListB
split_14 = SplitList(List=excelread_3.ExcelData, Index=1)  # -> ListA, ListB
series_31 = Series(Start=0, Step=0, Count=multiplication_6)
flip = FlipMatrix(Data=split_11.ListB)
flip_2 = FlipMatrix(Data=split_12.ListB)
flip_3 = FlipMatrix(Data=split_13.ListB)
flip_4 = FlipMatrix(Data=split_14.ListB)
pt_21 = ConstructPoint(XCoordinate=series_29, YCoordinate=series_28, ZCoordinate=0)
pt_22 = ConstructPoint(XCoordinate=series_29, YCoordinate=series_28, ZCoordinate=multiplication)
branch = TreeBranch(Tree=excelread_5.ExcelData, Path="14", MaintainPaths=True)
branch_2 = TreeBranch(Tree=excelread_5.ExcelData, Path="10", MaintainPaths=True)
branch_3 = TreeBranch(Tree=excelread_5.ExcelData, Path="12", MaintainPaths=True)
branch_4 = TreeBranch(Tree=excelread_5.ExcelData, Path="8", MaintainPaths=True)
toggle = BooleanToggle(True)
toggle_2 = BooleanToggle(True)
toggle_3 = BooleanToggle(True)
toggle_4 = BooleanToggle(True)
pt_23 = ConstructPoint(XCoordinate=expr("x+20", multiplication_2), YCoordinate=expr("-x-20", multiplication_3), ZCoordinate=0)
pt_24 = ConstructPoint(XCoordinate=0, YCoordinate=0, ZCoordinate=0)
branch_5 = TreeBranch(Tree=excelread_6.ExcelData, Path="6", MaintainPaths=True)
branch_6 = TreeBranch(Tree=excelread_6.ExcelData, Path="10", MaintainPaths=True)
ln_12 = Line(StartPoint=pt_21, EndPoint=pt_22)
branch_7 = TreeBranch(Tree=excelread_6.ExcelData, Path="8", MaintainPaths=True)
branch_8 = TreeBranch(Tree=excelread_6.ExcelData, Path="12", MaintainPaths=True)
split_15 = SplitList(List=branch, Index=1)  # -> ListA, ListB
mindex = MemberIndex(Set=split_15.ListB, Member="yes")  # -> Index, Count
replace = ReplaceItems(List=split_15.ListB, Item=ColourSwatch(SwatchColor=RGB(0, 255, 9)), Indices=mindex.Index, Wrap=False)
mindex_2 = MemberIndex(Set=replace, Member="no")  # -> Index, Count
replace_2 = ReplaceItems(List=replace, Item=ColourSwatch(SwatchColor=RGB(255, 0, 0)), Indices=mindex_2.Index, Wrap=False)
panel_7 = Panel(split_15.ListB)
split_16 = SplitList(List=branch_2, Index=1)  # -> ListA, ListB
split_17 = SplitList(List=branch_3, Index=1)  # -> ListA, ListB
split_18 = SplitList(List=branch_4, Index=1)  # -> ListA, ListB
vec2pt_2 = Vector2Pt(PointA=pt_24, PointB=pt_23, Unitize=False)  # -> Vector, Length
split_19 = SplitList(List=branch_6, Index=1)  # -> ListA, ListB
split_20 = SplitList(List=branch_7, Index=1)  # -> ListA, ListB
split_21 = SplitList(List=branch_8, Index=1)  # -> ListA, ListB
split_22 = SplitList(List=branch_5, Index=1)  # -> ListA, ListB
clean = CleanTree(RemoveNulls=toggle, RemoveInvalid=toggle, RemoveEmpty=toggle, Tree=flip_2)
clean_2 = CleanTree(RemoveNulls=toggle_2, RemoveInvalid=toggle_2, RemoveEmpty=toggle_2, Tree=flip)
clean_3 = CleanTree(RemoveNulls=toggle_3, RemoveInvalid=toggle_3, RemoveEmpty=toggle_3, Tree=flip_4)
clean_4 = CleanTree(RemoveNulls=toggle_4, RemoveInvalid=toggle_4, RemoveEmpty=toggle_4, Tree=flip_3)
len_16 = TextLength(Text=clean)
len_17 = TextLength(Text=clean_2)
len_18 = TextLength(Text=clean_3)
len_19 = TextLength(Text=clean_4)
cull = CullPattern(List=clean_2, CullPattern=len_17)  # -> simplify(List)
cull_2 = CullPattern(List=clean, CullPattern=len_16)
cull_3 = CullPattern(List=clean_4, CullPattern=len_19)  # -> simplify(List)
ma = MassAddition(Input=cull_3)  # -> Result, PartialResults
merge = Merge(Data1=simplify(graft(series_31)), Data2=simplify(ma.PartialResults))
eval_2 = EvaluateLength(Curve=simplify(graft(ln_11)), Length=merge, Normalized=False)  # -> Point, Tangent, Parameter
pline = PolyLine(Vertices=eval_2.Point, Closed=False)
cull_4 = CullPattern(List=clean_3, CullPattern=len_18)
swatch = ColourSwatch(SwatchColor=RGB(255, 0, 0))
rev = ReverseList(List=cull_2)
explode = Explode(Curve=pline, Recursive=True)  # -> Segments, Vertices
swatch_2 = ColourSwatch(SwatchColor=RGB(0, 255, 9))
rev_2 = ReverseList(List=cull)
ma_2 = MassAddition(Input=rev_2)  # -> Result, PartialResults
merge_2 = Merge(Data1=simplify(graft(series_30)), Data2=simplify(ma_2.PartialResults))
eval_3 = EvaluateLength(Curve=simplify(graft(ln_12)), Length=merge_2, Normalized=False)  # -> Point, Tangent, Parameter
pline_2 = PolyLine(Vertices=eval_3.Point, Closed=False)
explode_2 = Explode(Curve=pline_2, Recursive=True)  # -> Segments, Vertices
move_16 = Move(Geometry=explode_2.Segments, Motion=vec2pt_2.Vector)  # -> Geometry, Transform
move_17 = Move(Geometry=explode.Segments, Motion=vec2pt.Vector)  # -> Geometry, Transform
cluster = Cluster(data=rev, data_2=rev)
mindex_3 = MemberIndex(Set=split_21.ListB, Member="yes")  # -> Index, Count
lng_16 = ListLength(List=cull_4)  # -> flatten(Length)
replace_3 = ReplaceItems(List=split_21.ListB, Item=swatch_2, Indices=mindex_3.Index, Wrap=False)
mindex_4 = MemberIndex(Set=replace_3, Member="no")  # -> Index, Count
replace_4 = ReplaceItems(List=replace_3, Item=swatch, Indices=mindex_4.Index, Wrap=False)
panel_8 = Panel(cull_4)
lng_17 = ListLength(List=cull_2)  # -> flatten(Length)
panel_9 = Panel(split_21.ListB)
rev_3 = ReverseList(List=lng_16)
larger = LargerThan(FirstNumber=rev_3, SecondNumber="1")  # -> LargerThan, OrEqualTo
rev_4 = ReverseList(List=lng_17)
panel_10 = Panel("1")
larger_2 = LargerThan(FirstNumber=rev_4, SecondNumber="1")  # -> LargerThan, OrEqualTo
mindex_5 = MemberIndex(Set=larger.LargerThan, Member=Toggle(True))  # -> Index, Count
item_11 = ListItem(List=mindex_5.Index, Index=0, Wrap=True)
mindex_6 = MemberIndex(Set=larger_2.LargerThan, Member=Toggle(True))  # -> Index, Count
cluster_2 = Cluster(data=split_16.ListB, data_2=split_16.ListB)
item_12 = ListItem(List=mindex_6.Index, Index=0, Wrap=True)
cluster_3 = Cluster(data=split_20.ListB, data_2=split_20.ListB)
subtraction_6 = Subtraction(A=item_11, B=1)
split_23 = SplitList(List=rev_3, Index=subtraction_6)  # -> ListA, ListB
cluster_4 = Cluster(data=cull_4, data_2=cull_4)
readcstable = ReadCrossSectionTableFromFileKaramba3D()  # -> CrossSection, Info
readcstable_2 = ReadCrossSectionTableFromFileKaramba3D()  # -> CrossSection, Info
cluster_5 = Cluster(data=split_18.ListB, data_2=split_18.ListB)
cluster_6 = Cluster(data=split_22.ListB, data_2=split_22.ListB)
readcstable_3 = ReadCrossSectionTableFromFileKaramba3D()  # -> CrossSection, Info
split_24 = SplitList(List=rev_4, Index=item_12)  # -> ListA, ListB
readcstable_4 = ReadCrossSectionTableFromFileKaramba3D()  # -> CrossSection, Info
readcstable_5 = ReadCrossSectionTableFromFileKaramba3D()  # -> CrossSection, Info
readcstable_6 = ReadCrossSectionTableFromFileKaramba3D()  # -> CrossSection, Info
ma_3 = MassAddition(Input=split_23.ListA)  # -> Result, PartialResults
ma_4 = MassAddition(Input=split_23.ListB)  # -> Result, PartialResults
linetobeam = LineToBeamKaramba3D(
    Line=flatten(move_11.Geometry),
    Identifier=flatten(format_12),
    New=True,
    Remove=True,
    LimitDistance_m=0.005,
    Bending=True,
    SetBucklingLength=True,
    ToPolylineMaxAngle=0.03,
    ToPolylineTolerance=0.01,
    ToPolylineMinEdgeLength=0.25)  # -> Element, Points, Info
linetobeam_2 = LineToBeamKaramba3D(
    Line=flatten(move_12.Geometry),
    Identifier=flatten(format_13),
    New=True,
    Remove=True,
    LimitDistance_m=0.005,
    Bending=True,
    SetBucklingLength=True,
    ToPolylineMaxAngle=0.03,
    ToPolylineTolerance=0.01,
    ToPolylineMinEdgeLength=0.25)  # -> Element, Points, Info
crosecselect = CrossSectionSelectorKaramba3D(
    CrossSections=readcstable.CrossSection,
    NameOrListIndexOfCrossSection=graft(cluster_2),
    ElementsIdentifiers=graft(format_12))  # -> CrossSection, Info
crosecselect_2 = CrossSectionSelectorKaramba3D(
    CrossSections=readcstable_2.CrossSection,
    NameOrListIndexOfCrossSection=graft(cluster_3),
    ElementsIdentifiers=graft(format_13))  # -> CrossSection, Info
panel_11 = Panel(format_13)
linetobeam_3 = LineToBeamKaramba3D(
    Line=flatten(move_14.Geometry),
    Identifier=flatten(format_12),
    New=True,
    Remove=True,
    LimitDistance_m=0.005,
    Bending=True,
    SetBucklingLength=True,
    ToPolylineMaxAngle=0.03,
    ToPolylineTolerance=0.01,
    ToPolylineMinEdgeLength=0.25)  # -> Element, Points, Info
linetobeam_4 = LineToBeamKaramba3D(
    Line=flatten(move_15.Geometry),
    Identifier=flatten(format_13),
    New=True,
    Remove=True,
    LimitDistance_m=0.005,
    Bending=True,
    SetBucklingLength=True,
    ToPolylineMaxAngle=0.03,
    ToPolylineTolerance=0.01,
    ToPolylineMinEdgeLength=0.25)  # -> Element, Points, Info
crosecselect_3 = CrossSectionSelectorKaramba3D(
    CrossSections=readcstable_5.CrossSection,
    NameOrListIndexOfCrossSection=graft(cluster_5),
    ElementsIdentifiers=graft(format_12))  # -> CrossSection, Info
ma_5 = MassAddition(Input=split_24.ListA)  # -> Result, PartialResults
crosecselect_4 = CrossSectionSelectorKaramba3D(
    CrossSections=readcstable_3.CrossSection,
    NameOrListIndexOfCrossSection=graft(cluster_6),
    ElementsIdentifiers=graft(format_13))  # -> CrossSection, Info
ma_6 = MassAddition(Input=split_24.ListB)  # -> Result, PartialResults
stack = StackData(Data=swatch, Stack=ma_3.Result)
stack_2 = StackData(Data=swatch_2, Stack=ma_4.Result)
merge_3 = Merge(Data1=stack, Data2=stack_2)  # -> flatten(Result)
stack_3 = StackData(Data=swatch, Stack=ma_5.Result)
stack_4 = StackData(Data=swatch_2, Stack=ma_6.Result)
crosecselect_5 = CrossSectionSelectorKaramba3D(
    CrossSections=readcstable_4.CrossSection,
    NameOrListIndexOfCrossSection=graft(cluster_4),
    ElementsIdentifiers=graft(format_6))  # -> CrossSection, Info
assemble = AssembleModelKaramba3D(
    Elem=flatten([linetobeam.Element, linetobeam_2.Element]),
    CrossSection=flatten([crosecselect.CrossSection, crosecselect_2.CrossSection]),
    LimitDistance_m=0.005)  # -> Model, Info, Mass_kg, CenterOfGravity, LoadCaseNames
merge_4 = Merge(Data1=stack_3, Data2=stack_4)  # -> flatten(Result)
rev_5 = ReverseList(List=merge_3)
linetobeam_5 = LineToBeamKaramba3D(
    Line=flatten(move_17.Geometry),
    Color=flatten(rev_5),
    Identifier=flatten(format_6),
    New=True,
    Remove=True,
    LimitDistance_m=0.005,
    Bending=True,
    SetBucklingLength=True,
    ToPolylineMaxAngle=0.03,
    ToPolylineTolerance=0.01,
    ToPolylineMinEdgeLength=0.25)  # -> Element, Points, Info
assemble_2 = AssembleModelKaramba3D(
    Elem=flatten([linetobeam_3.Element, linetobeam_4.Element]),
    CrossSection=flatten([crosecselect_3.CrossSection, crosecselect_4.CrossSection]),
    LimitDistance_m=0.005)  # -> Model, Info, Mass_kg, CenterOfGravity, LoadCaseNames
panel_12 = Panel(format_8)
rev_6 = ReverseList(List=merge_4)
linetobeam_6 = LineToBeamKaramba3D(
    Line=flatten(move_16.Geometry),
    Color=flatten(rev_6),
    Identifier=flatten(format_9),
    New=True,
    Remove=True,
    LimitDistance_m=0.005,
    Bending=True,
    SetBucklingLength=True,
    ToPolylineMaxAngle=0.03,
    ToPolylineTolerance=0.01,
    ToPolylineMinEdgeLength=0.25)  # -> Element, Points, Info
crosecselect_6 = CrossSectionSelectorKaramba3D(
    CrossSections=readcstable_6.CrossSection,
    NameOrListIndexOfCrossSection=graft(cluster),
    ElementsIdentifiers=graft(format_9))  # -> CrossSection, Info
modelview = ModelViewKaramba3D(Model=assemble.Model, ResultFactors=1, ResultCase=-1)  # -> Model, DeformedMesh, DeformedAxes, DeformedModel
modelview_2 = ModelViewKaramba3D(Model=assemble_2.Model, ResultFactors=1, ResultCase=-1)  # -> Model, DeformedMesh, DeformedAxes, DeformedModel
panel_13 = Panel(format_6)
beamview = BeamViewKaramba3D(Model=assemble.Model)  # -> Model, MeshesOfRenderedBeams, DeformedBeamAxes, LegendColors, LegendTags
panel_14 = Panel(crosecselect_5.CrossSection)
beamview_2 = BeamViewKaramba3D(Model=assemble_2.Model)  # -> Model, MeshesOfRenderedBeams, DeformedBeamAxes, LegendColors, LegendTags
panel_15 = Panel(crosecselect_6.CrossSection)
readcstable_7 = ReadCrossSectionTableFromFileKaramba3D()  # -> CrossSection, Info
readcstable_8 = ReadCrossSectionTableFromFileKaramba3D()  # -> CrossSection, Info
linetobeam_7 = LineToBeamKaramba3D(
    Line=flatten(move_8.Geometry),
    Color=flatten(replace_2),
    Identifier=flatten(format_8),
    New=True,
    Remove=True,
    LimitDistance_m=0.005,
    Bending=True,
    SetBucklingLength=True,
    ToPolylineMaxAngle=0.03,
    ToPolylineTolerance=0.01,
    ToPolylineMinEdgeLength=0.25)  # -> Element, Points, Info
cluster_7 = Cluster(data=split_19.ListB, data_2=split_19.ListB)
cluster_8 = Cluster(data=split_17.ListB, data_2=split_17.ListB)
panel_16 = Panel(cluster_8)
crosecselect_7 = CrossSectionSelectorKaramba3D(
    CrossSections=readcstable_7.CrossSection,
    NameOrListIndexOfCrossSection=graft(cluster_8),
    ElementsIdentifiers=graft(format_8))  # -> CrossSection, Info
panel_17 = Panel(format_7)
linetobeam_8 = LineToBeamKaramba3D(
    Line=flatten(move_6.Geometry),
    Color=flatten(replace_4),
    Identifier=flatten(format_7),
    New=True,
    Remove=True,
    LimitDistance_m=0.005,
    Bending=True,
    SetBucklingLength=True,
    ToPolylineMaxAngle=0.03,
    ToPolylineTolerance=0.01,
    ToPolylineMinEdgeLength=0.25)  # -> Element, Points, Info
crosecselect_8 = CrossSectionSelectorKaramba3D(
    CrossSections=readcstable_8.CrossSection,
    NameOrListIndexOfCrossSection=graft(cluster_7),
    ElementsIdentifiers=graft(format_7))  # -> CrossSection, Info
assemble_3 = AssembleModelKaramba3D(
    Elem=flatten([linetobeam_7.Element, linetobeam_6.Element]),
    CrossSection=flatten([crosecselect_7.CrossSection, crosecselect_6.CrossSection]),
    LimitDistance_m=0.005)  # -> Model, Info, Mass_kg, CenterOfGravity, LoadCaseNames
panel_18 = Panel(cluster_7)
assemble_4 = AssembleModelKaramba3D(
    Elem=flatten([linetobeam_5.Element, linetobeam_8.Element]),
    CrossSection=flatten([crosecselect_5.CrossSection, crosecselect_8.CrossSection]),
    LimitDistance_m=0.005)  # -> Model, Info, Mass_kg, CenterOfGravity, LoadCaseNames
panel_19 = Panel(crosecselect_7.CrossSection)
modelview_3 = ModelViewKaramba3D(Model=assemble_3.Model, ResultFactors=1, ResultCase=-1)  # -> Model, DeformedMesh, DeformedAxes, DeformedModel
panel_20 = Panel(crosecselect_8.CrossSection)
modelview_4 = ModelViewKaramba3D(Model=assemble_4.Model, ResultFactors=1, ResultCase=-1)  # -> Model, DeformedMesh, DeformedAxes, DeformedModel
beamview_3 = BeamViewKaramba3D(Model=modelview_3.Model)  # -> Model, MeshesOfRenderedBeams, DeformedBeamAxes, LegendColors, LegendTags
beamview_4 = BeamViewKaramba3D(Model=modelview_4.Model)  # -> Model, MeshesOfRenderedBeams, DeformedBeamAxes, LegendColors, LegendTags

# ==== cluster Cluster
data = ClusterInput()
data_2 = ClusterInput()
data_3 = Data(data)
data_4 = Data(data_2)
split = TextSplit(Text=data_3, Separators=" ")
split_2 = TextSplit(Text=data_4, Separators=" ")
chars = Characters(Text=split)  # -> Result, Unicode
chars_2 = Characters(Text=split_2)  # -> Result, Unicode
tmatch = MatchText(Text=chars.Result, Pattern="[0-9.]", Case=True)
tmatch_2 = MatchText(Text=chars_2.Result, Pattern="[A-Z.]", Case=True)
cull = CullPattern(List=chars.Result, CullPattern=tmatch)
cull_2 = CullPattern(List=chars_2.Result, CullPattern=tmatch_2)
join = TextJoin(Text=cull)  # -> flatten(Result)
join_2 = TextJoin(Text=cull_2)  # -> flatten(Result)
format = Format(Format="{0}{1}", Culture=127, Data0=join_2, Data1=join)
panel = Panel(data_3)
T = ClusterOutput(format)

# ==== cluster GetFloorheight
panel = Panel("""3
7.2
200""")
panel_2 = Panel("""3
10.8
260""")
panel_3 = Panel("""3
5.4
200""")
panel_4 = Panel("""3
3.6
200""")
panel_5 = Panel("""1
5.4
206""")
panel_6 = Panel("""1
7.2
296""")
panel_7 = Panel("""1
10.8
562""")
panel_8 = Panel("""1
3.6
200""")
entwine = Entwine(
    Branch00=panel_8,
    Branch01=panel_5,
    Branch02=panel_6,
    Branch03=panel_7,
    Branch04=panel_4,
    Branch05=panel_3,
    Branch06=panel,
    Branch07=panel_2,
    FlattenInputs=True)
P = ClusterInput()
tmatch = MatchText(Text=entwine, Pattern=P, Case=True)
dispatch = Dispatch(List=tmatch, DispatchPattern=tmatch)  # -> ListA, ListB
lng = ListLength(List=dispatch.ListA)
equals = Equality(FirstNumber=lng, SecondNumber="2")  # -> Equality, Inequality
dispatch_2 = Dispatch(List=entwine, DispatchPattern=equals.Equality)  # -> ListA, ListB
item = ListItem(List=dispatch_2.ListA, Index="2", Wrap=True)  # -> flatten(Item)
clean = CleanTree(RemoveNulls=True, RemoveInvalid=True, RemoveEmpty=False, Tree=item)
T = ClusterOutput(clean)
